# Grasshopper definition PavilionOne.gh (Grasshopper 0.9.76)
# plug-ins: Karamba, Kangaroo Components, PTComponentLibrary, Weaverbird, Kangaroo2 Components, TT Toolbox

# ---- group: XTranslationControlWatchOutItShouldMatchTheTranslationsThatAreBelowCheckByViewingTheRedWatchOutGroupToTheRight
number_slider = Slider(11, range=0..30)

# ---- group: GridFourOurValleysAndMountains
planar_grid = PlanarGrid(
    BasePoint=Point(0, 0, 0),
    IDir=Vector(1, 0, 0),
    JDir=Vector(0, 1, 0),
    IDistance=Slider(3.491, range=0..10),
    JDistance=Slider(2.04, range=0..10),
    INumber=6,
    JNumber=number_slider)  # -> simplify(Grid)

# ---- group: SetUpOurMeshAndTheTranslations
number_slider_2 = Slider(0, range=0..7)
number_slider_3 = Slider(5, range=0..7)
pickarowwithoutloosingbranch = CSharpScript(tree=planar_grid, branch=number_slider_2)  # -> selected; inputs tree: tree of Point3d, branch: Int32
# ---------- pickarowwithoutloosingbranch: C# ----------
    var treeOut = new DataTree<Point3d>();
    
    var size = tree.BranchCount;
    
    for( int i = branch; i < branch + 1; ++i )
      for( int j = 0; j < tree.Branch(i).Count; ++j )
      {
      
        treeOut.Add( tree.Branch(i)[j], new GH_Path( i ) );
      
      }
    
    selected = treeOut;
# ---------- end pickarowwithoutloosingbranch ----------
pickarowwithoutloosingbranch_2 = CSharpScript(tree=planar_grid, branch=number_slider_3)  # -> selected; inputs tree: tree of Point3d, branch: Int32; same code as pickarowwithoutloosingbranch
unit_y = UnitY(Factor=Slider(0, range=-10..10))
move = Move(Geometry=pickarowwithoutloosingbranch, Motion=expr("-x", unit_y))  # -> Geometry, Transform
pickarowwithoutloosingbranch_3 = CSharpScript(tree=planar_grid, branch=Slider(4, range=0..7))  # -> selected; inputs tree: tree of Point3d, branch: Int32; same code as pickarowwithoutloosingbranch
pickarowwithoutloosingbranch_4 = CSharpScript(tree=planar_grid, branch=Slider(3, range=0..7))  # -> selected; inputs tree: tree of Point3d, branch: Int32; same code as pickarowwithoutloosingbranch
pickarowwithoutloosingbranch_5 = CSharpScript(tree=planar_grid, branch=Slider(2, range=0..7))  # -> selected; inputs tree: tree of Point3d, branch: Int32; same code as pickarowwithoutloosingbranch
unit_y_2 = UnitY(Factor=Slider(0, range=-10..10))
pickarowwithoutloosingbranch_6 = CSharpScript(tree=planar_grid, branch=Slider(1, range=0..7))  # -> selected; inputs tree: tree of Point3d, branch: Int32; same code as pickarowwithoutloosingbranch
number_slider_4 = Slider(22, range=0..100)
number_slider_5 = Slider(21, range=0..100)
number_slider_6 = Slider(7, range=0..10)
number_slider_7 = Slider(5, range=0..10)
number_slider_8 = Slider(24, range=0..100)
number_slider_9 = Slider(2, range=0..10)
number_slider_10 = Slider(7, range=0..10)
number_slider_11 = Slider(6, range=0..100)
number_slider_12 = Slider(2, range=0..10)
number_slider_13 = Slider(4, range=0..10)
number_slider_14 = Slider(3, range=0..50)
number_slider_15 = Slider(32, range=0..100)
number_slider_16 = Slider(28, range=0..100)
move_2 = Move(Geometry=pickarowwithoutloosingbranch_2, Motion=unit_y_2)  # -> Geometry, Transform
number_slider_17 = Slider(21, range=0..100)
number_slider_18 = Slider(0, range=-1..1)
unit_y_3 = UnitY(Factor=Slider(0, range=-2..2))
unit_y_4 = UnitY(Factor=[Slider(0, range=-4..1), Slider(0, range=-4..2), Slider(0, range=-4..4)])
list_item = ListItem(List=move_2.Geometry, Index=number_slider_4, Wrap=True)
unit_y_5 = UnitY(Factor=Slider(0, range=-2..2))
unit_y_6 = UnitY(Factor=[Slider(0, range=0..2), Slider(0, range=-5..5.001), Slider(0, range=0..1)])
list_item_2 = ListItem(List=pickarowwithoutloosingbranch_3, Index=[number_slider_5, number_slider_7, number_slider_6], Wrap=True)
list_item_3 = ListItem(List=pickarowwithoutloosingbranch_4, Index=number_slider_9, Wrap=True)
cull_index = CullIndex(List=move_2.Geometry, Indices=number_slider_4, Wrap=True)
list_item_4 = ListItem(List=pickarowwithoutloosingbranch_5, Index=[number_slider_11, number_slider_13, number_slider_12], Wrap=True)
cull_index_2 = CullIndex(List=pickarowwithoutloosingbranch_3, Indices=[number_slider_5, number_slider_7, number_slider_6], Wrap=True)
unit_y_7 = UnitY(Factor=[Slider(0, range=-1..3), Slider(0, range=-2..3), Slider(0, range=-4..4)])
cull_index_3 = CullIndex(List=pickarowwithoutloosingbranch_4, Indices=number_slider_9, Wrap=True)
cull_index_4 = CullIndex(List=pickarowwithoutloosingbranch_5, Indices=[number_slider_11, number_slider_13, number_slider_12], Wrap=True)
list_item_5 = ListItem(List=pickarowwithoutloosingbranch_6, Index=[number_slider_15, number_slider_14, number_slider_16], Wrap=True)
unit_y_8 = UnitY(Factor=Slider(0, range=-2..2))
cull_index_5 = CullIndex(List=pickarowwithoutloosingbranch_6, Indices=[number_slider_15, number_slider_14, number_slider_16], Wrap=True)
list_item_6 = ListItem(List=move.Geometry, Index=number_slider_17, Wrap=True)
cull_index_6 = CullIndex(List=move.Geometry, Indices=number_slider_17, Wrap=True)
move_3 = Move(Geometry=list_item, Motion=expr("-x", unit_y_3))  # -> Geometry, Transform
move_4 = Move(Geometry=list_item_2, Motion=expr("-x", unit_y_4))  # -> Geometry, Transform
move_5 = Move(Geometry=list_item_3, Motion=expr("-x", unit_y_5))  # -> Geometry, Transform
path_mapper = PathMapper(cull_index, source="{A;B}", target="{A}")
move_6 = Move(Geometry=list_item_4, Motion=unit_y_6)  # -> Geometry, Transform
path_mapper_2 = PathMapper(cull_index_2, source="{A;B}", target="{A}")
move_7 = Move(Geometry=list_item_5, Motion=expr("-x", unit_y_7))  # -> Geometry, Transform
path_mapper_3 = PathMapper(cull_index_3, source="{A;B}", target="{A}")
path_mapper_4 = PathMapper(cull_index_4, source="{A;B}", target="{A}")
move_8 = Move(Geometry=list_item_6, Motion=expr("-x", unit_y_8))  # -> Geometry, Transform
path_mapper_5 = PathMapper(cull_index_5, source="{A;B}", target="{A}")
path_mapper_6 = PathMapper(cull_index_6, source="{A;B}", target="{A}")
point = Point([path_mapper, move_3.Geometry])
point_2 = Point([path_mapper_2, move_4.Geometry])
point_3 = Point([path_mapper_3, move_5.Geometry])
point_4 = Point([path_mapper_4, move_6.Geometry])
point_5 = Point([path_mapper_5, move_7.Geometry])
point_6 = Point([path_mapper_6, move_8.Geometry])
sort_points = SortPoints(Points=point)  # -> Points, Indices
sort_points_2 = SortPoints(Points=point_2)  # -> Points, Indices
sort_points_3 = SortPoints(Points=point_3)  # -> Points, Indices
sort_points_4 = SortPoints(Points=point_4)  # -> Points, Indices
sort_points_5 = SortPoints(Points=point_5)  # -> Points, Indices
sort_points_6 = SortPoints(Points=point_6)  # -> Points, Indices
point_list = PointList(Points=sort_points_2.Points)
point_list_2 = PointList(Points=sort_points_3.Points)
merge = Merge(
    Data1=sort_points_6.Points,
    Data2=sort_points_5.Points,
    Data3=sort_points_4.Points,
    Data4=sort_points_3.Points,
    Data5=sort_points_2.Points,
    Data6=sort_points.Points)

# ----
pickarowwithoutloosingbranch_7 = CSharpScript(tree=planar_grid, branchStart=number_slider_2, branchEnd=number_slider_3, randomOrNot=Toggle(False))  # -> selected; inputs tree: tree of Point3d, branchStart: Int32, branchEnd: Int32, randomOrNot: Boolean
# ---------- pickarowwithoutloosingbranch_7: C# ----------
    var treeOut = new DataTree<Point3d>();

    var size = tree.BranchCount;

    for( int i = branchStart + 1; i < branchEnd; ++i )
      for( int j = 0; j < tree.Branch(i).Count; ++j )
      {

        if( randomOrNot == false )
        {

          if( i != 2 && i != 3 )


            treeOut.Add(tree.Branch(i)[j], new GH_Path(i));

        }

        else
        {

          //if( i != 2 && i != 3 && i != 4 && i != 5 )


          treeOut.Add(tree.Branch(i)[j], new GH_Path(i));

        }

      }

    selected = treeOut;
# ---------- end pickarowwithoutloosingbranch_7 ----------

# ---- group: Attractors
point_7 = Point(merge)
curve = Curve(<curve referenced from the Rhino model>)
point_8 = Point(Point(42.54006911, -14.3092749, 0))
point_9 = Point(<point referenced from the Rhino model>)
spin_force = SpinForce(
    Plane=point_8,
    Strength=expr("-x", Slider(10, range=0..10)),
    Radius=Slider(10, range=0..10),
    Decay=Slider(1.216, range=0..10))
spin_force_2 = SpinForce(
    Plane=point_9,
    Strength=expr("-x", Slider(1.9897, range=0..100)),
    Radius=Slider(10, range=0..10),
    Decay=Slider(0, range=0..10))
merge_fields = MergeFields(Fields=flatten(spin_force_2))
evaluate_field = EvaluateField(Field=merge_fields, Point=point_7)  # -> Tensor, Strength
point_10 = Point([<point referenced from the Rhino model> x2])
random_attraction = RandomAttraction(Grid=point_7, Magnitude=Slider(0, range=0..1))  # -> simplify(Grid), Weights
curve_attraction = CurveAttraction(Grid=point_7, CrvAtts=curve, Magnitude=Slider(0.78, range=0..1))  # -> simplify(Grid), Weights
point_attraction = PointAttraction(Grid=point_7, PtAtts=point_10, Magnitude=Slider(1, range=0..1))  # -> simplify(Grid), Weights
move_9 = Move(Geometry=point_7, Motion=evaluate_field.Tensor)  # -> Geometry, Transform
point_11 = Point(point_7)

# ----
curve_2 = Curve(<curve referenced from the Rhino model>)
divide_curve = DivideCurve(Curve=curve_2, Count=Slider(19, range=0..1000), Kinks=False)  # -> Points, Tangents, Parameters
point_12 = Point(<point referenced from the Rhino model>)
point_13 = Point(<point referenced from the Rhino model>)
point_14 = Point(<point referenced from the Rhino model>)
point_15 = Point(<point referenced from the Rhino model>)
point_16 = Point(<point referenced from the Rhino model>)
polyline = PolyLine(Vertices=divide_curve.Points, Closed=False)
point_charge = PointCharge(Point=point_12, Charge=Slider(3.5152, range=0..10), Decay=Slider(0, range=0..10))
point_charge_2 = PointCharge(Point=point_13, Charge=Slider(0, range=0..10), Decay=Slider(0, range=0..10))
point_charge_3 = PointCharge(Point=point_14, Charge=Slider(1.8125, range=0..10), Decay=Slider(0, range=0..10))
point_charge_4 = PointCharge(Point=point_15, Charge=Slider(4.3967, range=0..10), Decay=Slider(0, range=0..10))
discontinuity = Discontinuity(Curve=polyline, Level=2)  # -> Points, Parameters
deconstruct = Deconstruct(Point=Point(4.690061528, 8.392349977, 0))  # -> XComponent, YComponent, ZComponent
shatter = Shatter(Curve=polyline, Parameters=discontinuity.Parameters)
line_charge = LineCharge(Line=shatter, Charge=Slider(5.392, range=0..10))
merge_fields_2 = MergeFields(Fields=line_charge)
evaluate_field_2 = EvaluateField(Field=line_charge, Point=point_7)  # -> Tensor, Strength
number_slider_19 = Slider(0, range=-5..5)
addition = Addition(A=deconstruct.XComponent, B=number_slider_19)
number_slider_20 = Slider(0, range=-5..5)
addition_2 = Addition(A=deconstruct.YComponent, B=number_slider_20)
construct_point = ConstructPoint(XCoordinate=addition, YCoordinate=addition_2, ZCoordinate=deconstruct.ZComponent)
point_charge_5 = PointCharge(Point=construct_point, Charge=Slider(1.1985, range=0..10), Decay=Slider(0, range=0..10))
merge_fields_3 = MergeFields(Fields=flatten([point_charge_5, point_charge, point_charge_3, point_charge_4, point_charge_2]))
evaluate_field_3 = EvaluateField(Field=merge_fields_3, Point=curve_attraction.Grid)  # -> Tensor, Strength
move_10 = Move(Geometry=point_7, Motion=evaluate_field_2.Tensor)  # -> simplify(Geometry), Transform
move_11 = Move(Geometry=curve_attraction.Grid, Motion=evaluate_field_3.Tensor)  # -> simplify(Geometry), Transform

# ---- group: ParametricMagicThanksRelativeItem
boolean_toggle = BooleanToggle(False)
flip_matrix = FlipMatrix(Data=move_11.Geometry)
relative_item = RelativeItem(Tree=move_11.Geometry, Offset="{0}[+1]", WrapPaths=boolean_toggle, WrapItems=boolean_toggle)  # -> ItemA, ItemB
relative_item_2 = RelativeItem(Tree=flip_matrix, Offset="{0}[+1]", WrapPaths=boolean_toggle, WrapItems=boolean_toggle)  # -> ItemA, ItemB
relative_item_3 = RelativeItem(Tree=move_11.Geometry, Offset="{+1}[+1]", WrapPaths=boolean_toggle, WrapItems=boolean_toggle)  # -> ItemA, ItemB
relative_item_4 = RelativeItem(Tree=move_11.Geometry, Offset="{+1}[-1]", WrapPaths=boolean_toggle, WrapItems=boolean_toggle)  # -> ItemA, ItemB
line = Line(StartPoint=relative_item.ItemA, EndPoint=relative_item.ItemB)
line_2 = Line(StartPoint=relative_item_4.ItemA, EndPoint=relative_item_4.ItemB)
line_3 = Line(StartPoint=relative_item_2.ItemA, EndPoint=relative_item_2.ItemB)
line_4 = Line(StartPoint=relative_item_3.ItemA, EndPoint=relative_item_3.ItemB)
boolean_toggle_2 = BooleanToggle(False)
relative_item_5 = RelativeItem(Tree=line_4, Offset="{+2}[0]", WrapPaths=boolean_toggle_2, WrapItems=boolean_toggle_2)  # -> ItemA, ItemB
relative_item_6 = RelativeItem(Tree=line_2, Offset="{+2}[0]", WrapPaths=boolean_toggle_2, WrapItems=boolean_toggle_2)  # -> ItemA, ItemB
relative_item_7 = RelativeItem(Tree=line_3, Offset="{+2}[0]", WrapPaths=boolean_toggle_2, WrapItems=boolean_toggle_2)  # -> ItemA, ItemB
relative_item_8 = RelativeItem(Tree=line, Offset="{+2}[0]", WrapPaths=boolean_toggle_2, WrapItems=boolean_toggle_2)  # -> ItemA, ItemB
boolean_toggle_3 = BooleanToggle(False)
line_5 = Line(relative_item_6.ItemB)
line_6 = Line(relative_item_6.ItemA)
line_7 = Line(relative_item_5.ItemB)
line_8 = Line(relative_item_5.ItemA)
line_9 = Line(relative_item_7.ItemB)
line_10 = Line(relative_item_7.ItemA)
line_11 = Line(relative_item_8.ItemB)
line_12 = Line(relative_item_8.ItemA)
relative_item_9 = RelativeItem(Tree=line_9, Offset="{+1}[0]", WrapPaths=boolean_toggle_3, WrapItems=boolean_toggle_3)  # -> ItemA, ItemB
relative_item_10 = RelativeItem(Tree=line_11, Offset="{+1}[0]", WrapPaths=boolean_toggle_3, WrapItems=boolean_toggle_3)  # -> ItemA, ItemB
relative_item_11 = RelativeItem(Tree=line_10, Offset="{+1}[0]", WrapPaths=boolean_toggle_3, WrapItems=boolean_toggle_3)  # -> ItemA, ItemB
relative_item_12 = RelativeItem(Tree=line_12, Offset="{+1}[0]", WrapPaths=boolean_toggle_3, WrapItems=boolean_toggle_3)  # -> ItemA, ItemB
relative_item_13 = RelativeItem(Tree=line_8, Offset="{+1}[0]", WrapPaths=boolean_toggle_3, WrapItems=boolean_toggle_3)  # -> ItemA, ItemB
relative_item_14 = RelativeItem(Tree=line_7, Offset="{+1}[0]", WrapPaths=boolean_toggle_3, WrapItems=boolean_toggle_3)  # -> ItemA, ItemB
relative_item_15 = RelativeItem(Tree=line_6, Offset="{+1}[0]", WrapPaths=boolean_toggle_3, WrapItems=boolean_toggle_3)  # -> ItemA, ItemB
relative_item_16 = RelativeItem(Tree=line_5, Offset="{+1}[0]", WrapPaths=boolean_toggle_3, WrapItems=boolean_toggle_3)  # -> ItemA, ItemB
line_13 = Line(relative_item_9.ItemB)
line_14 = Line(relative_item_10.ItemB)
line_15 = Line(relative_item_11.ItemA)
line_16 = Line(relative_item_12.ItemA)
line_17 = Line(relative_item_13.ItemB)
line_18 = Line(relative_item_14.ItemA)
line_19 = Line(relative_item_15.ItemB)
line_20 = Line(relative_item_16.ItemA)
flip_matrix_2 = FlipMatrix(Data=line_13)
flip_matrix_3 = FlipMatrix(Data=line_14)
flip_matrix_4 = FlipMatrix(Data=line_15)
flip_matrix_5 = FlipMatrix(Data=line_16)
cull_pattern = CullPattern(List=line_17, CullPattern=[False, True])
cull_pattern_2 = CullPattern(List=line_18, CullPattern=invert([False, True]))
cull_pattern_3 = CullPattern(List=line_19, CullPattern=invert([False, True]))
cull_pattern_4 = CullPattern(List=line_20, CullPattern=[False, True])
list_item_7 = ListItem(List=flip_matrix_3, Index=Slider(5, range=0..10), Wrap=True)
list_item_8 = ListItem(List=flip_matrix_4, Index=0, Wrap=True)
list_item_9 = ListItem(List=flip_matrix_5, Index=0, Wrap=True)
list_item_10 = ListItem(List=flip_matrix_2, Index=Slider(15, range=0..20), Wrap=True)
flip_matrix_6 = FlipMatrix(Data=cull_pattern)
flip_matrix_7 = FlipMatrix(Data=cull_pattern_2)
flip_matrix_8 = FlipMatrix(Data=cull_pattern_3)
flip_matrix_9 = FlipMatrix(Data=cull_pattern_4)

# ----
subtraction = Subtraction(A=number_slider, B=1)

# ---- group: Borders
number_slider_21 = Slider(18, range=0..100)
flip_matrix_10 = FlipMatrix(Data=move_11.Geometry)
flip_matrix_11 = FlipMatrix(Data=move_11.Geometry)
pickarowwithoutloosingbranch_8 = CSharpScript(tree=flip_matrix_10, branch=Slider(0, range=0..100))  # -> selected; inputs tree: tree of Point3d, branch: Int32; same code as pickarowwithoutloosingbranch
pickarowwithoutloosingbranch_9 = CSharpScript(tree=flip_matrix_11, branch=subtraction)  # -> selected; inputs tree: tree of Point3d, branch: Int32
# ---------- pickarowwithoutloosingbranch_9: C# ----------
    var treeOut = new DataTree<Point3d>();

    var size = tree.BranchCount;

    for( int i = branch; i < branch + 1; ++i )
      for( int j = 0; j < tree.Branch(i).Count; ++j )
      {

        treeOut.Add(tree.Branch(i)[j], new GH_Path(i));

      }

    selected = treeOut;
# ---------- end pickarowwithoutloosingbranch_9 ----------
cull_pattern_5 = CullPattern(List=pickarowwithoutloosingbranch_8, CullPattern=[True, False, True, True, False])
cull_pattern_6 = CullPattern(List=pickarowwithoutloosingbranch_9, CullPattern=[True, False, True, True, False])
join_curves = JoinCurves(Curves=flatten(list_item_8), Preserve=False)
join_curves_2 = JoinCurves(Curves=flatten(list_item_10), Preserve=False)
curve_closest_point = CurveClosestPoint(Point=cull_pattern_5, Curve=join_curves)  # -> Point, Parameter, Distance
curve_closest_point_2 = CurveClosestPoint(Point=cull_pattern_6, Curve=join_curves_2)  # -> Point, Parameter, Distance
shatter_2 = Shatter(Curve=join_curves, Parameters=curve_closest_point.Parameter)
shatter_3 = Shatter(Curve=join_curves_2, Parameters=curve_closest_point_2.Parameter)

# ----
centerlines = CSharpScript(lines=line_3)  # -> linesOut; inputs lines: tree of Line
# ---------- centerlines: C# ----------
    var lineTree = new DataTree<Line>();
    
    for( int i = 0; i < lines.BranchCount; ++i )
      for( int j = 1; j < lines.Branch(i).Count - 1; ++j )
      {
      
        if( i % 2 != 0 )
        lineTree.Add( lines.Branch(i)[j], new GH_Path(i) );
        
      }
    
    linesOut = lineTree;
# ---------- end centerlines ----------
leftintersectionrlines = CSharpScript(lines=line_3)  # -> linesOut; inputs lines: tree of Line
# ---------- leftintersectionrlines: C# ----------
    var lineTree = new DataTree<Line>();

    for( int i = 1; i < lines.BranchCount - 1; ++i )
      for( int j = 3; j < lines.Branch(i).Count; ++j )
      {

        if( i % 2 != 1 )
          lineTree.Add(lines.Branch(i)[j], new GH_Path(i));

      }

    linesOut = lineTree;
# ---------- end leftintersectionrlines ----------
rigthintersectionrlines = CSharpScript(lines=line_3)  # -> linesOut; inputs lines: tree of Line
# ---------- rigthintersectionrlines: C# ----------
    var lineTree = new DataTree<Line>();

    for( int i = 1; i < lines.BranchCount - 1; ++i )
      for( int j = 0; j < lines.Branch(i).Count - 3; ++j )
      {

        if( i % 2 != 1 )
          lineTree.Add(lines.Branch(i)[j], new GH_Path(i));

      }

    linesOut = lineTree;
# ---------- end rigthintersectionrlines ----------
leftintersectionrlines_2 = CSharpScript(lines=line_3)  # -> linesOut; inputs lines: tree of Line
# ---------- leftintersectionrlines_2: C# ----------
    var lineTree = new DataTree<Line>();

    for( int i = 0; i < lines.BranchCount; ++i )
      for( int j = 3; j < lines.Branch(i).Count; ++j )
      {

        if( i % 2 != 1 )
          lineTree.Add(lines.Branch(i)[j], new GH_Path(i));

      }

    linesOut = lineTree;
# ---------- end leftintersectionrlines_2 ----------
rigthintersectionrlines_2 = CSharpScript(lines=line_3)  # -> linesOut; inputs lines: tree of Line
# ---------- rigthintersectionrlines_2: C# ----------
    var lineTree = new DataTree<Line>();

    for( int i = 0; i < lines.BranchCount; ++i )
      for( int j = 0; j < lines.Branch(i).Count - 3; ++j )
      {

        if( i % 2 != 1 )
          lineTree.Add(lines.Branch(i)[j], new GH_Path(i));

      }

    linesOut = lineTree;
# ---------- end rigthintersectionrlines_2 ----------
join_curves_3 = JoinCurves(Curves=rigthintersectionrlines, Preserve=False)
join_curves_4 = JoinCurves(Curves=centerlines, Preserve=False)
join_curves_5 = JoinCurves(Curves=rigthintersectionrlines_2, Preserve=False)
join_curves_6 = JoinCurves(Curves=leftintersectionrlines, Preserve=False)
join_curves_7 = JoinCurves(Curves=leftintersectionrlines_2, Preserve=False)
end_points = EndPoints(Curve=join_curves_3)  # -> Start, End
end_points_2 = EndPoints(Curve=join_curves_4)  # -> Start, End
end_points_3 = EndPoints(Curve=join_curves_5)  # -> Start, End
end_points_4 = EndPoints(Curve=join_curves_6)  # -> Start, End
end_points_5 = EndPoints(Curve=join_curves_7)  # -> Start, End
line_21 = Line(StartPoint=end_points_4.Start, EndPoint=end_points_4.End)  # -> simplify(Line)
line_22 = Line(StartPoint=end_points.Start, EndPoint=end_points.End)  # -> simplify(Line)
line_23 = Line(StartPoint=end_points_2.Start, EndPoint=end_points_2.End)  # -> simplify(Line)
line_24 = Line(StartPoint=end_points_5.Start, EndPoint=end_points_5.End)  # -> simplify(Line)
line_25 = Line(StartPoint=end_points_3.Start, EndPoint=end_points_3.End)  # -> simplify(Line)
topbottomlines = CSharpScript(lines=line_3)  # -> linesOut; inputs lines: tree of Line
# ---------- topbottomlines: C# ----------
    var lineTree = new DataTree<Line>();

    for( int i = 0; i < lines.BranchCount; ++i )
      for( int j = 2; j < lines.Branch(i).Count - 2; ++j )
      {

        if( i % 2 != 1 )
          lineTree.Add(lines.Branch(i)[j], new GH_Path(i));

      }

    linesOut = lineTree;
# ---------- end topbottomlines ----------
rightcenterlines = CSharpScript(lines=line_3)  # -> linesOut; inputs lines: tree of Line
# ---------- rightcenterlines: C# ----------
    var lineTree = new DataTree<Line>();

    for( int i = 0; i < lines.BranchCount; ++i )
      for( int j = 0; j < lines.Branch(i).Count - 4; ++j )
      {

        if( i % 2 != 0 )
          lineTree.Add(lines.Branch(i)[j], new GH_Path(i));

      }

    linesOut = lineTree;
# ---------- end rightcenterlines ----------
leftcenterlines = CSharpScript(lines=line_3)  # -> linesOut; inputs lines: tree of Line
# ---------- leftcenterlines: C# ----------
    var lineTree = new DataTree<Line>();

    for( int i = 0; i < lines.BranchCount; ++i )
      for( int j = 4; j < lines.Branch(i).Count; ++j )
      {

        if( i % 2 != 0 )
          lineTree.Add(lines.Branch(i)[j], new GH_Path(i));

      }

    linesOut = lineTree;
# ---------- end leftcenterlines ----------
list_item_11 = ListItem(List=flip_matrix_6, Index=0, Wrap=True)
list_item_12 = ListItem(List=flip_matrix_7, Index=1, Wrap=True)
list_item_13 = ListItem(List=flip_matrix_8, Index=0, Wrap=True)
list_item_14 = ListItem(List=flip_matrix_9, Index=1, Wrap=True)

pickarowwithoutloosingbranch_10 = CSharpScript(tree=move_11.Geometry, branch=Slider(0, range=0..100))  # -> selected; inputs tree: tree of Point3d, branch: Int32; same code as pickarowwithoutloosingbranch
cull_pattern_7 = CullPattern(List=pickarowwithoutloosingbranch_10, CullPattern=[True, False, True, True, False])
topbottomlines_2 = CSharpScript(lines=line_3)  # -> linesOut; inputs lines: tree of Line; same code as topbottomlines
join_curves_8 = JoinCurves(Curves=flatten(list_item_10), Preserve=False)
curve_closest_point_3 = CurveClosestPoint(Point=cull_pattern_7, Curve=join_curves_8)  # -> Point, Parameter, Distance
topbottomlines_3 = CSharpScript(lines=line_3)  # -> linesOut; inputs lines: tree of Line
# ---------- topbottomlines_3: C# ----------
    var lineTree = new DataTree<Line>();

    for( int i = 1; i < lines.BranchCount - 1; ++i )
      for( int j = 2; j < lines.Branch(i).Count - 2; ++j )
      {

        if( i % 2 != 1 )
          lineTree.Add(lines.Branch(i)[j], new GH_Path(i));

      }

    linesOut = lineTree;
# ---------- end topbottomlines_3 ----------
shatter_4 = Shatter(Curve=join_curves_8, Parameters=curve_closest_point_3.Parameter)
divide_curve_2 = DivideCurve(Curve=topbottomlines_2, Count=2, Kinks=False)  # -> Points, Tangents, Parameters
list_item_15 = ListItem(List=divide_curve_2.Points, Index=1, Wrap=True)  # -> flatten(Item)
list_length = ListLength(List=list_item_15)
shift_list = ShiftList(List=list_item_15, Shift=1, Wrap=True)
vector_2pt = Vector2Pt(PointA=list_item_15, PointB=shift_list, Unitize=False)  # -> Vector, Length
point_list_3 = PointList(Points=list_item_15)
cull_index_7 = CullIndex(List=vector_2pt.Vector, Indices=list_length, Wrap=True)
vector_display = VectorDisplay(Anchor=list_item_15, Vector=vector_2pt.Vector)
vector_length = VectorLength(Vector=vector_2pt.Vector)

# ---- group: MeshConstruction
curve_3 = Curve([list_item_11, list_item_12, list_item_13, list_item_14, leftcenterlines, rightcenterlines, topbottomlines, list_item_7, list_item_9])
curve_4 = Curve([line_23, line_24, line_25])
curve_5 = Curve([curve_4, curve_3])
weaverbird_s_mesh_from_lines_weave_back = WeaverbirdsMeshFromLinesWeaveBack(Lines=flatten(curve_5), MaximumValence=Slider(5, range=0..10))

# ----
distancetwopoints = CSharpScript(points=list_item_15)  # -> distance; inputs points: list of Point3d
# ---------- distancetwopoints: C# ----------
    var distances = new List<double>();
    var size = points.Count;

    for( int i = 0; i < size; ++i )
    {

      if( i != size - 1 )

        distances.Add(points[i].DistanceTo(points[i + 1]));

    }

    distance = distances;
# ---------- end distancetwopoints ----------
panel = Panel(distancetwopoints)
fitness = CSharpScript(distances=distancetwopoints, min=Slider(3.12, range=0..5), max=Slider(0.39, range=0..1))  # -> penalty; inputs distances: list of Double, min: Double, max: Double
# ---------- fitness: C# ----------
    double penal = 0.0;
    
    for( int i = 0; i < distances.Count; ++i )
    {
    
      if( i != distances.Count - 1 )
      {
        
        var temp = distances[i] - distances[i+1];
    
        if( temp >= min || temp <= max )
          penal -= 1000;
    
      }
    
    }
    /*
    var temp = distances[0] - distances[1];
    
    if( temp <= 0.1 || temp >= 0.2 )
      penal -= 1000;*/
    
    penalty = penal;
# ---------- end fitness ----------
deconstruct_mesh = DeconstructMesh(Mesh=weaverbird_s_mesh_from_lines_weave_back)  # -> Vertices, Faces, Colours, Normals
panel_2 = Panel(fitness)
list_length_2 = ListLength(List=deconstruct_mesh.Faces)
panel_3 = Panel(list_length_2)
angle = Panel("-pi")
angle_2 = Panel("pi")

# ---- group: SimulationReset
reset = Button()
toggle = BooleanToggle(False)

# ---- group: mesh of flat folding pattern
mesh = Mesh(weaverbird_s_mesh_from_lines_weave_back)

# ----
galapagos_listener = GalapagosListener(Reset=True)  # -> Fitness, Iterations
galapagos = Galapagos(fitness=fitness, gene=[number_slider_19, number_slider_20])
folding = Slider(0.626, range=0..0.99)

# ---- group: KangarooOne
curve_6 = Curve([line_23, line_21, line_22])
curve_7 = Curve([list_item_9, list_item_7, list_item_11, list_item_12, list_item_13, list_item_14, leftcenterlines, rightcenterlines, topbottomlines, shatter_2, shatter_3])
valleys = Curve(flatten(curve_6))
mountains = Curve(flatten(curve_7))
origami = Origami(mesh=weaverbird_s_mesh_from_lines_weave_back, C=valleys, num_4=angle, C_2=mountains, num_2=angle_2, num=folding)  # -> data_2, R
timer = Timer(TimerInterval=20, Target=kangaroophysics)
kangaroophysics = KangarooPhysics(ForceObjects=origami.data_2, Settings=null, Geometry=origami.R, SimulationReset=Toggle(True))  # -> Out, Iterations, ParticlesOut, GeometryOut, KE
mesh_2 = Mesh(kangaroophysics.GeometryOut)

# ----
hingepoints = HingePoints(Mesh=mesh)  # -> _1, _2, _3, _4
end_points_6 = EndPoints(Curve=join_curves)  # -> Start, End
end_points_7 = EndPoints(Curve=join_curves_2)  # -> Start, End

# ---- group: maintain edge lengths
medges = MeshEdges(Mesh=mesh)  # -> NakedEdges, InteriorEdges, NonManifoldEdges
length_line = LengthLine(Line=[medges.NakedEdges, medges.InteriorEdges], Strength=1)

# ---- group: a weak plastic anchor on all points prevents drift
demesh = DeconstructMesh(Mesh=mesh)  # -> Vertices, Faces, Colours, Normals
plasticanchor = PlasticAnchor(Point=demesh.Vertices, Limit=0.1, Strength=0.01)

# ---- group: AnchorPointsAlthoughWeDontNeedThemNoMore
join_curves_9 = JoinCurves(Curves=line_24, Preserve=False)
join_curves_10 = JoinCurves(Curves=line_25, Preserve=False)
end_points_8 = EndPoints(Curve=join_curves_9)  # -> Start, End
end_points_9 = EndPoints(Curve=join_curves_10)  # -> Start, End
point_17 = Point(end_points_8.End)
point_18 = Point(end_points_9.Start)

# ----
zombiekangaroo = ZombieKangaroo(ForceObjects=origami.data_2, Settings=null, Geometry=origami.R, Threshold=0.1, MaxIters=2000)  # -> Out, Iterations, ParticlesOut, GeometryOut, KE
mesh_3 = Mesh(zombiekangaroo.GeometryOut)
list_item_16 = ListItem(List=zombiekangaroo.ParticlesOut, Index=Slider(23, range=0..100), Wrap=True)
list_item_17 = ListItem(List=zombiekangaroo.ParticlesOut, Index=Slider(4, range=0..100), Wrap=True)
list_item_18 = ListItem(List=zombiekangaroo.ParticlesOut, Index=0, Wrap=True)
deconstruct_mesh_2 = DeconstructMesh(Mesh=mesh_3)  # -> Vertices, Faces, Colours, Normals

# ---- group: MeasureSizeOfGrid
list_item_19 = ListItem(List=flatten(planar_grid), Index=Slider(8, range=0..100), Wrap=True)
list_item_20 = ListItem(List=flatten(planar_grid), Index=Slider(45, range=0..100), Wrap=True)
list_item_21 = ListItem(List=flatten(planar_grid), Index=Slider(0, range=0..100), Wrap=True)
distance = Distance(PointA=list_item_21, PointB=list_item_19)
distance_2 = Distance(PointA=list_item_21, PointB=list_item_20)
panel_4 = Panel(distance_2)
panel_5 = Panel(distance)

# ---- group: WeShouldntNeedThisOnes
load = Load(ForceVector=Vector(0, 0, 1))
point_19 = Point([point_17, point_18])
move_12 = Move(Geometry=graft(point_19), Motion=Vector(0, 0, 10))  # -> Geometry, Transform
anchor = Anchor(Point=flatten(move_12.Geometry), Strength=1000)

# ----
construct_point_2 = ConstructPoint(XCoordinate=0, YCoordinate=0, ZCoordinate=0)
plane_3pt = Plane3Pt(PointA=list_item_18, PointB=list_item_17, PointC=list_item_16)
target = Target(Plane(origin=(18.62992375, -1.150245166, 0), x=(0.004986066788, 0.9999875695, 0), y=(0.9999875695, -0.004986066788, 0)))
point_list_4 = PointList(Points=deconstruct_mesh_2.Vertices)
plane_origin = PlaneOrigin(Base=target, Origin=construct_point_2)
orient = Orient(Geometry=mesh_3, Source=plane_3pt, Target=plane_origin)  # -> Geometry, Transform
area = Area(Geometry=mesh_3)  # -> Area, Centroid
mesh_edges = MeshEdges(Mesh=orient.Geometry)  # -> NakedEdges, InteriorEdges, NonManifoldEdges
curve_8 = Curve(mesh_edges.NakedEdges)
discontinuity_2 = Discontinuity(Curve=curve_8, Level=1)  # -> Points, Parameters
unit_y_9 = UnitY(Factor=1)
deconstruct_mesh_3 = DeconstructMesh(Mesh=orient.Geometry)  # -> Vertices, Faces, Colours, Normals
face_normals = FaceNormals(Mesh=orient.Geometry)  # -> Centers, Normals
move_13 = Move(Geometry=face_normals.Centers, Motion=unit_y_9)  # -> Geometry, Transform
vector_2pt_2 = Vector2Pt(PointA=face_normals.Centers, PointB=move_13.Geometry, Unitize=True)  # -> Vector, Length
reverse = Reverse(Vector=face_normals.Normals)
move_14 = Move(Geometry=face_normals.Centers, Motion=reverse)  # -> Geometry, Transform
vector_display_2 = VectorDisplay(Anchor=face_normals.Centers, Vector=reverse)
vector_display_3 = VectorDisplay(Anchor=face_normals.Centers, Vector=vector_2pt_2.Vector)
angle_3 = Angle(VectorA=vector_2pt_2.Vector, VectorB=reverse)  # -> Angle, Reflex
degrees = Degrees(Radians=angle_3.Angle)
angular_dimension = AngularDimension(
    Center=face_normals.Centers,
    PointA=move_14.Geometry,
    PointB=move_13.Geometry,
    Reflex=False,
    Text="{0:0.0}°",
    Size=Slider(0.226, range=0..1))
mass_addition = MassAddition(Input=degrees)  # -> Result, PartialResults
list_length_3 = ListLength(List=degrees)
panel_6 = Panel("S")  # disabled
division = Division(A=mass_addition.Result, B=list_length_3)

# ----
# 3
panel_7 = Panel("-1")  # disabled
Z = UnitZ(Factor=panel_7)  # disabled

number_slider_22 = Slider(0, range=0..10)  # disabled
number = Number(93.01814949)
number_slider_23 = Slider(10, range=0..10)  # disabled
number_2 = Number(division)
panel_8 = Panel(number)
panel_9 = Panel(number_2)
negative = Negative(Value=number_slider_22)  # disabled
negative_2 = Negative(Value=number_slider_23)  # disabled
unit_z = UnitZ(Factor=negative)  # disabled
number_slider_24 = Slider(1.256, range=0..10)  # disabled
unit_z_2 = UnitZ(Factor=negative_2)  # disabled
loads_karamba = LoadsKaramba(Vector=unit_z, LCase=0, mode="Gravity")  # disabled
loads_karamba_2 = LoadsKaramba(Vector=unit_z_2, LCase=0, mode="Gravity")  # disabled
mesh_4 = Mesh(<mesh referenced from the Rhino model>)  # disabled
mesh_edges_2 = MeshEdges(Mesh=mesh_4)  # -> NakedEdges, InteriorEdges, NonManifoldEdges; disabled
deconstruct_mesh_4 = DeconstructMesh(Mesh=mesh_4)  # -> Vertices, Faces, Colours, Normals; disabled

# ---- group: GeometryShell / Shell
mesh_5 = Mesh(mesh_4)  # disabled

# ----
curve_9 = Curve(mesh_edges_2.NakedEdges)  # disabled

# ---- group: GeometryShell
# 1
# 2
meshtoshell = MeshToShellKaramba(Mesh=mesh_5, LDist=0.005, Identifier=panel_6)  # -> Point, Element, Info; disabled

# ----
mesh_to_shell_karamba = MeshToShellKaramba(Mesh=mesh_5, LimitDistance_m=0.005)  # -> Element, Points, Info; disabled
closest_point = ClosestPoint(Point=point_19, Cloud=deconstruct_mesh_4.Vertices)  # -> ClosestPoint, CPIndex, Distance; disabled
mesh_to_shell_karamba_2 = MeshToShellKaramba(Mesh=mesh_4, LimitDistance_m=0.005)  # -> Element, Points, Info; disabled

# ---- group: Material
matselect = MaterialSelectionKaramba(ElementsIdentifiers=meshtoshell.Element, menu=[dropdown(1), dropdown(3)])  # disabled

# ----
demesh_2 = DeconstructMesh(Mesh=mesh_5)  # -> Vertices, Faces, Colours, Normals; disabled
medges_2 = MeshEdges(Mesh=mesh_5)  # -> NakedEdges, InteriorEdges, NonManifoldEdges; disabled

# ---- group: CrossSection
cross_sections = CrossSectionsKaramba(ElementsIdentifiers=meshtoshell.Element, Heights_cm=1, mode="Shell")  # disabled

# ---- group: Load
loads = LoadsKaramba(Vector=Z, Mesh=mesh_5, LCase=0, mode="Mesh Load", menu=[buttons(off, on, off), buttons(on, on)])  # disabled

# ----
disc = Discontinuity(Curve=medges_2.NakedEdges, Level=1)  # -> Points, Parameters; disabled
deconstruct_2 = Deconstruct(Point=disc.Points)  # -> XComponent, YComponent, ZComponent; disabled
smaller_than = SmallerThan(FirstNumber=deconstruct_2.ZComponent, SecondNumber=number_slider_24)  # -> SmallerThan, OrEqualTo; disabled
cull_pattern_8 = CullPattern(List=disc.Points, CullPattern=invert(smaller_than.SmallerThan))  # disabled
vector_2pt_3 = Vector2Pt(PointA=cull_pattern_8, PointB=unit_z, Unitize=False)  # -> Vector, Length; disabled
pt = Point(disc.Points)  # disabled
modifyelem = ModifyElementKaramba(mode="Shell")  # disabled
cull_pattern_9 = CullPattern(List=disc.Points, CullPattern=smaller_than.SmallerThan)  # -> flatten(List); disabled
remove_duplicate_points_karamba = RemoveDuplicatePointsKaramba(Point=cull_pattern_9, LimitDistance=0.005)  # -> OutPoint, Info, Indexes; disabled
support_karamba = SupportKaramba(PosInd=remove_duplicate_points_karamba.OutPoint, menu=[buttons(on, on, on, on, off, off)])  # disabled
assemble_model_karamba = AssembleModelKaramba(
    Points=mesh_to_shell_karamba_2.Points,
    Elem=mesh_to_shell_karamba_2.Element,
    Support=support_karamba,
    Load=loads_karamba_2,
    LimitDistance_m=0.005)  # -> Model, Info, Mass_kg, CenterOfGravity; disabled
number_slider_25 = Slider(10, range=0..10)  # disabled

# ---- group: Support
supp = SupportKaramba(PosInd=cull_pattern_9, menu=[buttons(on, on, on, on, off, off)])  # disabled

# ---- group: AssembleModel
# 4
assemble = AssembleModelKaramba(
    Point=mesh_to_shell_karamba.Points,
    Elem=mesh_to_shell_karamba.Element,
    Support=supp,
    Load=loads_karamba,
    CrossSection=cross_sections,
    Material=matselect,
    LimitDistance_m=0.005)  # -> Model, Info, Mass_kg, CenterOfGravity; disabled

# ----
# 5
model_view_karamba = ModelViewKaramba(Model=assemble.Model, LoadCaseFactorsForLinearSuperposition=1, IndexOfVisibleLoadcase=-1)  # -> Model, DeformedMesh, DeformedAxes, DeformedModel; disabled
mesh_to_shell_karamba_3 = MeshToShellKaramba(Mesh=mesh_4, LimitDistance_m=0.005)  # -> Element, Points, Info; disabled
negative_3 = Negative(Value=number_slider_25)  # disabled
shelllineresults = LineResultsOnShellsKaramba(Layer=0, SegmentLength_m=0.5, DA_deg=5, Theta_deg=0, mode="ForceFlow")  # -> AnalyzedModel, Lines; disabled
analyzethi_karamba = AnalyzeThIKaramba(Model=assemble_model_karamba.Model)  # -> CalculatedModel, MaximumDisplacement_m, ResultingForceOfGravity_kN, ElasticEnergy_kNm; disabled
unit_z_3 = UnitZ(Factor=negative_3)  # disabled
model_view_karamba_2 = ModelViewKaramba(Model=model_view_karamba.Model, LoadCaseFactorsForLinearSuperposition=1, IndexOfVisibleLoadcase=-1)  # -> Model, DeformedMesh, DeformedAxes, DeformedModel; disabled
dismload = DisassembleMeshLoadKaramba()  # -> PointLoad, ElementLoad; disabled
loads_karamba_3 = LoadsKaramba(Vector=unit_z_3, LCase=0, mode="Gravity")  # disabled
shell_view_karamba = ShellViewKaramba(Model=model_view_karamba_2.Model, IndexOfLayer=0)  # -> Model, MeshesOfRenderedShells, LegendColors, LegendTags; disabled
model_view_karamba_3 = ModelViewKaramba(Model=analyzethi_karamba.CalculatedModel, LoadCaseFactorsForLinearSuperposition=1, IndexOfVisibleLoadcase=-1)  # -> Model, DeformedMesh, DeformedAxes, DeformedModel; disabled

# ---- group: ViewModel
# 6
shellview = ShellViewKaramba()  # -> Model, MeshesOfRenderedShells, LegendColors, LegendTags; disabled
nodedisp = NodalDisplacementsKaramba()  # -> AnalyzedModel, NodalTranslations_m, NodalRotations_rad; disabled
vec = Vector(nodedisp.NodalRotations_rad)  # disabled
num = Number()  # disabled
vec_2 = Vector(nodedisp.NodalTranslations_m)  # disabled
mesh_6 = Mesh(shell_view_karamba.MeshesOfRenderedShells)  # disabled
vec_3 = Vector()  # disabled
num_2 = Number()  # disabled
num_3 = Number()  # disabled
vec_4 = Vector()  # disabled
num_4 = Number()  # disabled
pt_2 = Point()  # disabled
num_5 = Number()  # disabled
num_6 = Number()  # disabled
num_7 = Number()  # disabled

# ----
assemble_model_karamba_2 = AssembleModelKaramba(
    Points=mesh_to_shell_karamba_3.Points,
    Elem=mesh_to_shell_karamba_3.Element,
    Support=support_karamba,
    Load=loads_karamba_3,
    CrossSection=cross_sections,
    Material=matselect,
    LimitDistance_m=0.005)  # -> Model, Info, Mass_kg, CenterOfGravity; disabled
shellvecresults = ResultVectorsOnShellsKaramba(AnalyzedModel=shell_view_karamba.Model, LayerOfResults=0, mode="PrincStress")  # -> AnalyzedModel, Points, FirstPrincipalStressVector_kN_cm2, SecondPrincipalStressVector_kN_cm2, FirstPrincipalStressValue_kN_cm2, SecondPrincipalStressValue_kN_cm2; disabled
pt_3 = Point(shellvecresults.Points)  # disabled
vec_5 = Vector()  # disabled
vec_6 = Vector()  # disabled
shell_view_karamba_2 = ShellViewKaramba(Model=model_view_karamba_3.Model, IndexOfLayer=0)  # -> Model, MeshesOfRenderedShells, LegendColors, LegendTags; disabled
analyzethi_karamba_2 = AnalyzeThIKaramba(Model=assemble_model_karamba_2.Model)  # -> CalculatedModel, MaximumDisplacement_m, ResultingForceOfGravity_kN, ElasticEnergy_kNm; disabled
legend = Legend(Colour=shellview.LegendColors, Tags=shellview.LegendTags, LegendType=1)  # disabled
mesh_7 = Mesh(shell_view_karamba_2.MeshesOfRenderedShells)  # disabled
model_view_karamba_4 = ModelViewKaramba(Model=analyzethi_karamba_2.CalculatedModel, LoadCaseFactorsForLinearSuperposition=1, IndexOfVisibleLoadcase=-1)  # -> Model, DeformedMesh, DeformedAxes, DeformedModel; disabled
besobeam = BESOForBeamsKaramba(
    LCases=0,
    TargetMassRatio=0.5,
    NumberOfChangeIterations=10,
    NumberOfConvergenceIterations=20,
    WeightingFactorForTension=1,
    WeightingFactorForCompression=1,
    WeightingFactorForShear=0,
    WeightingFactorForMoments=0,
    BESOFactor=0,
    MinimumDistanceBetweenChangingElements=0,
    RelativeWeightLimit=0)  # -> MaximumDisplacement, OptimizedModel, HistoryOfTheBESO, ElementIsActive, DistributionOfWeights; disabled
shell_view_karamba_3 = ShellViewKaramba(Model=model_view_karamba_4.Model, IndexOfLayer=0)  # -> Model, MeshesOfRenderedShells, LegendColors, LegendTags; disabled
mesh_8 = Mesh(shell_view_karamba_3.MeshesOfRenderedShells)  # disabled
line_results_on_shells_karamba = LineResultsOnShellsKaramba(
    AnalyzedModel=shell_view_karamba_3.Model,
    Layer=0,
    GlobalForceDirections=unit_z_3,
    SegmentLength_m=0.5,
    DA_deg=5,
    Theta_deg=0,
    mode="ForceFlow")  # -> AnalyzedModel, Lines; disabled

curve_10 = Curve([list_item_11, list_item_12, list_item_13, list_item_14, leftcenterlines, rightcenterlines, shatter_2, shatter_3, list_item_7, list_item_9, topbottomlines_3])
curve_11 = Curve([line_23, line_21, line_22])
valleys_2 = Curve(flatten(curve_11))
mountains_2 = Curve(flatten(curve_10))
folding_2 = Slider(0, range=0..0.99)
rad = Radians(Degrees=Slider(-180, range=-360..360))
rad_2 = Radians(Degrees=Slider(45, range=-360..360))
hingepoints_2 = HingePoints(Mesh=mesh)  # -> _1, _2, _3, _4
multiplication = Multiplication(A=angle_2, B=folding_2)
multiplication_2 = Multiplication(A=angle, B=folding_2)
ln = Line(StartPoint=hingepoints._1, EndPoint=hingepoints._2)
hinge = Hinge(
    FoldStart=hingepoints._1,
    FoldEnd=hingepoints._2,
    Tip1=hingepoints._3,
    Tip2=hingepoints._4,
    RestAngle=expr("-x", multiplication),
    Strength=0.1)
hinge_2 = Hinge(
    FoldStart=hingepoints._1,
    FoldEnd=hingepoints._2,
    Tip1=hingepoints._3,
    Tip2=hingepoints._4,
    RestAngle=expr("-x", multiplication_2),
    Strength=0.1)
show = Show(G=mesh)
eval = EvaluateCurve(Curve=ln, Parameter=0.5)  # -> graft(Point), Tangent, Angle

# ---- group: Mountain fold lines
crv = Curve(mountains_2)

# ---- group: Valley fold lines
crv_2 = Curve(valleys_2)

# ----
eval_2 = EvaluateCurve(Curve=reparameterize(crv_2), Parameter=0.5)  # -> Point, Tangent, Angle
eval_3 = EvaluateCurve(Curve=reparameterize(crv), Parameter=0.5)  # -> Point, Tangent, Angle
dist = Distance(PointA=eval_2.Point, PointB=eval.Point)
dist_2 = Distance(PointA=eval_3.Point, PointB=eval.Point)
sort = SortList(Keys=dist)  # -> Keys, ValuesA
sort_2 = SortList(Keys=dist_2)  # -> Keys, ValuesA
item = ListItem(List=sort.Keys, Index=0, Wrap=True)
item_2 = ListItem(List=sort_2.Keys, Index=0, Wrap=True)
smaller = SmallerThan(FirstNumber=item, SecondNumber=0.01)  # -> flatten(SmallerThan), OrEqualTo
smaller_2 = SmallerThan(FirstNumber=item_2, SecondNumber=0.01)  # -> flatten(SmallerThan), OrEqualTo
cull = CullPattern(List=hinge_2, CullPattern=smaller.SmallerThan)
cull_2 = CullPattern(List=hinge, CullPattern=smaller_2.SmallerThan)

# ---- group: Output
solver = Solver(GoalObjects=[length_line, cull, cull_2, show, plasticanchor], Reset=reset, Threshold=1e-15, Tolerance=0.01, On=toggle)  # -> I, V, O
onlymeshes = CSharpScript(x=solver.O)  # -> out, A; inputs x: tree
# ---------- onlymeshes: C# ----------
    var meshOut = new List<object>();

    for( int i = 0; i < x.BranchCount; ++i )
      for( int j = 0; j < x.Branch(i).Count; ++j )
      {
  
        if( x.Branch(i)[j] != null )
          
          if( x.Branch(i)[j].GetType() == typeof( Rhino.Geometry.Mesh ) )
        
            meshOut.Add(x.Branch(i)[j]);
  
      }

    A = meshOut;
# ---------- end onlymeshes ----------

# ==== cluster Origami: Fold a flat pattern into 3d origami
mesh = ClusterInput()
mesh_2 = Mesh(mesh)
num = ClusterInput()
num_2 = ClusterInput()
hingepoints = HingePoints(Mesh=mesh_2)  # -> _1, _2, _3, _4
strength = Panel("1")
num_3 = Number(num)
C = ClusterInput()
C_2 = ClusterInput()
num_4 = ClusterInput()
strength_2 = Panel("1")
num_5 = Number(num_2)
num_6 = Number(strength)
eval = EvaluateCurve(Curve=reparameterize(C), Parameter=0.5)  # -> Point, Tangent, Angle
eval_2 = EvaluateCurve(Curve=reparameterize(C_2), Parameter=0.5)  # -> Point, Tangent, Angle
ln = Line(StartPoint=hingepoints._1, EndPoint=hingepoints._2)
num_7 = Number(num_4)
num_8 = Number(strength_2)
tri = Triangulate(Mesh=mesh_2)  # -> Mesh, Count
multiplication = Multiplication(A=num_7, B=num_3)
multiplication_2 = Multiplication(A=num_5, B=num_3)
eval_3 = EvaluateCurve(Curve=reparameterize(ln), Parameter=0.5)  # -> graft(Point), Tangent, Angle
springsfrommesh = SpringsFromMesh(M=tri.Mesh, stiffness=100, B=1)
planarizequads = PlanarizeQuads(M=mesh_2, planarizestrength=1000)
unweld = UnweldMesh(Mesh=mesh_2, Angle=0)
cp = ClosestPoint(Point=eval_3.Point, Cloud=eval_2.Point)  # -> ClosestPoint, CPIndex, Distance
cp_2 = ClosestPoint(Point=eval_3.Point, Cloud=eval.Point)  # -> ClosestPoint, CPIndex, Distance
R = ClusterOutput(unweld)
larger = LargerThan(FirstNumber=0.01, SecondNumber=cp.Distance)  # -> LargerThan, OrEqualTo
larger_2 = LargerThan(FirstNumber=0.01, SecondNumber=cp_2.Distance)  # -> LargerThan, OrEqualTo
cull = CullPattern(List=num_8, CullPattern=larger_2.LargerThan)
cull_2 = CullPattern(List=multiplication, CullPattern=larger_2.LargerThan)
cull_3 = CullPattern(List=num_6, CullPattern=larger.LargerThan)
cull_4 = CullPattern(List=multiplication_2, CullPattern=larger.LargerThan)
addition = Addition(A=cull, B=cull_3)
addition_2 = Addition(A=cull_2, B=cull_4)
addition_3 = Addition(A=0, B=addition)  # -> flatten(Result)
addition_4 = Addition(A=0, B=addition_2)  # -> flatten(Result)
hinge = Hinge(
    Point1=hingepoints._1,
    Point2=hingepoints._2,
    Point3=hingepoints._3,
    Point4=hingepoints._4,
    Strength=addition_3,
    RestAngle=addition_4)
data = Data([springsfrommesh, hinge, planarizequads])
data_2 = ClusterOutput(data)

# ==== cluster PlanarizeQuads: Applies a planarization force to any quads in a mesh
M = ClusterInput()
mcomp = Decompose(Mesh=M)  # -> Vertices, Faces, Colours, Normals
vertices = FaceVertices(Face=mcomp.Faces)  # -> CornerA, CornerB, CornerC, CornerD
planarizestrength = ClusterInput()
item = ListItem(List=mcomp.Vertices, Index=vertices.CornerA, Wrap=False)
item_2 = ListItem(List=mcomp.Vertices, Index=vertices.CornerB, Wrap=False)
item_3 = ListItem(List=mcomp.Vertices, Index=vertices.CornerC, Wrap=False)
item_4 = ListItem(List=mcomp.Vertices, Index=vertices.CornerD, Wrap=False)
planarize = Planarize(Point1=item, Point2=item_2, Point3=item_3, Point4=item_4, PlanarizeStrength=planarizestrength)
equals = Equality(FirstNumber=vertices.CornerC, SecondNumber=vertices.CornerD)  # -> Equality, Inequality
cull = CullPattern(List=planarize, CullPattern=equals.Inequality)
L = ClusterOutput(cull)

# ==== cluster SpringsFromMesh: Turns all edges of a mesh into springs
M = ClusterInput()
medges = MeshEdges(Mesh=M)  # -> NakedEdges, InteriorEdges, NonManifoldEdges
crv = Curve([medges.NakedEdges, medges.InteriorEdges])
B = ClusterInput()
len = Length(Curve=crv)
multiplication = Multiplication(A=len, B=B)
stiffness = ClusterInput()
springs = SpringsFromLine(Connection=crv, Stiffness=stiffness, Damping=10, RestLength=multiplication, UpperCutoff=0, LowerCutoff=0, Plasticity=0)
S = ClusterOutput(springs)
