# Grasshopper definition PavilionTwo.gh (Grasshopper 0.9.76)
# plug-ins: Karamba, Kangaroo Components, PTComponentLibrary, Weaverbird, Kangaroo2 Components, HAL [Data Utilities]

# ---- group: GridAndVariations
always_even_odd = AlwaysEvenOdd(Integer=Slider(13, range=0..100), EvenOdd=True)  # -> Integer, Corrected
planar_grid = PlanarGrid(
    BasePoint=Point(0, 0, 0),
    IDir=Vector(1, 0, 0),
    JDir=Vector(0, 1, 0),
    IDistance=Slider(1, range=0..1),
    JDistance=Slider(1, range=0..1),
    INumber=8,
    JNumber=always_even_odd.Integer)  # -> simplify(Grid)
construct_domain = ConstructDomain(DomainStart=Slider(0, range=0..100), DomainEnd=Slider(1, range=0..10))
number_slider = Slider(10, range=0..10)
range = Range(Domain=construct_domain, Steps=number_slider)
list_length = ListLength(List=flatten(planar_grid))
number_slider_2 = Slider(0.186, range=0..1)
graph_mapper = GraphMapper(
    range,
    x0=0,
    x1=1,
    y0=0,
    y1=1,
    amplitude=0.5,
    container_name="Perlin",
    decay=0.3,
    frequency=0.06811523438,
    x_offset=0.5,
    y_offset=0.5)
construct_point = ConstructPoint(XCoordinate=0, YCoordinate=0, ZCoordinate=0)
construct_domain_2 = ConstructDomain(DomainStart=Slider(0, range=0..1), DomainEnd=list_length)
series = Series(Start=0, Step=1, Count=number_slider)
unit_x = UnitX(Factor=graph_mapper)
random = Random(Range=construct_domain_2, Number=list_length, Seed=Slider(4280, range=0..10000))
unit_y = UnitY(Factor=graph_mapper)
unit_y_2 = UnitY(Factor=series)
move = Move(Geometry=construct_point, Motion=unit_y_2)  # -> Geometry, Transform
floor = CSharpScript(numbers=random, howMany=Slider(10, range=0..10))  # -> floored; inputs numbers: list of Double, howMany: Int32
# ---------- floor: C# ----------
    var numbersOut = new List<int>();
    
    for( int i = 0; i < howMany; ++i )
    {
    
      numbersOut.Add( Convert.ToInt32( numbers[i] ) );
      
    } 
    
    floored = numbersOut;
# ---------- end floor ----------
series_2 = Series(Start=0, Step=1, Count=number_slider)
panel = Panel(floor)
list_item = ListItem(List=flatten(planar_grid), Index=Slider(59, range=0..100), Wrap=True)
list_item_2 = ListItem(List=flatten(planar_grid), Index=Slider(22, range=0..100), Wrap=True)
unit_x_2 = UnitX(Factor=series_2)
move_2 = Move(Geometry=move.Geometry, Motion=unit_x_2)  # -> Geometry, Transform
move_3 = Move(Geometry=move_2.Geometry, Motion=unit_y)  # -> Geometry, Transform
list_item_3 = ListItem(List=flatten(planar_grid), Index=floor, Wrap=True)
polyline = PolyLine(Vertices=move_3.Geometry, Closed=False)
number_slider_3 = Slider(65, range=0..100)
number_slider_4 = Slider(0, range=0..200)
point_charge = PointCharge(Point=list_item_3, Charge=Slider(0.4893, range=0..1), Decay=2)
spin_force = SpinForce(Plane=list_item, Strength=Slider(1.067, range=0..100), Radius=5, Decay=Slider(0.187, range=0..10))
spin_force_2 = SpinForce(Plane=list_item_2, Strength=Slider(1.111, range=0..100), Radius=5, Decay=Slider(2.102, range=0..10))
merge_fields = MergeFields(Fields=[spin_force, spin_force_2])
merge_fields_2 = MergeFields(Fields=point_charge)
curve = Curve(polyline)
list_item_4 = ListItem(List=flatten(planar_grid), Index=number_slider_3, Wrap=True)
list_item_5 = ListItem(List=flatten(planar_grid), Index=number_slider_4, Wrap=True)
evaluate_field = EvaluateField(Field=flatten([merge_fields_2, merge_fields]), Point=planar_grid)  # -> simplify(Tensor), Strength
evaluate_field_2 = EvaluateField(Field=merge_fields, Point=planar_grid)  # -> Tensor, Strength
direction_attraction = DirectionAttraction(Grid=planar_grid, Magnitude=Slider(10, range=0..10), Dir=Vector(21.28300888, 15.42176085, 0))  # -> Grid, Weights
curve_attraction = CurveAttraction(Grid=planar_grid, CrvAtts=curve, Magnitude=1)  # -> simplify(Grid), Weights
point_attraction = PointAttraction(Grid=planar_grid, PtAtts=[list_item_5, list_item_4], Magnitude=Slider(2.67, range=0..10))  # -> simplify(Grid), Weights
random_attraction = RandomAttraction(Grid=planar_grid, Magnitude=Slider(0.5042, range=0..1))  # -> simplify(Grid), Weights
move_4 = Move(Geometry=planar_grid, Motion=evaluate_field_2.Tensor)  # -> Geometry, Transform
move_5 = Move(Geometry=planar_grid, Motion=evaluate_field.Tensor)  # -> simplify(Geometry), Transform

# ----
galapagos = Galapagos(fitness=analyzethi_karamba, gene=[number_slider_4, number_slider_3])

# ---- group: ParametricMagicThanksRelativeItem
boolean_toggle = BooleanToggle(False)
flip_matrix = FlipMatrix(Data=move_5.Geometry)
relative_item = RelativeItem(Tree=move_5.Geometry, Offset="{0}[+1]", WrapPaths=boolean_toggle, WrapItems=boolean_toggle)  # -> ItemA, ItemB
relative_item_2 = RelativeItem(Tree=flip_matrix, Offset="{0}[+1]", WrapPaths=boolean_toggle, WrapItems=boolean_toggle)  # -> ItemA, ItemB
relative_item_3 = RelativeItem(Tree=move_5.Geometry, Offset="{+1}[+1]", WrapPaths=boolean_toggle, WrapItems=boolean_toggle)  # -> ItemA, ItemB
relative_item_4 = RelativeItem(Tree=move_5.Geometry, Offset="{+1}[-1]", WrapPaths=boolean_toggle, WrapItems=boolean_toggle)  # -> ItemA, ItemB
line = Line(StartPoint=relative_item.ItemA, EndPoint=relative_item.ItemB)
line_2 = Line(StartPoint=relative_item_4.ItemA, EndPoint=relative_item_4.ItemB)
line_3 = Line(StartPoint=relative_item_2.ItemA, EndPoint=relative_item_2.ItemB)
line_4 = Line(StartPoint=relative_item_3.ItemA, EndPoint=relative_item_3.ItemB)
boolean_toggle_2 = BooleanToggle(False)
relative_item_5 = RelativeItem(Tree=line_3, Offset="{+2}[0]", WrapPaths=boolean_toggle_2, WrapItems=boolean_toggle_2)  # -> ItemA, ItemB
relative_item_6 = RelativeItem(Tree=line, Offset="{+2}[0]", WrapPaths=boolean_toggle_2, WrapItems=boolean_toggle_2)  # -> ItemA, ItemB
relative_item_7 = RelativeItem(Tree=line_4, Offset="{+2}[0]", WrapPaths=boolean_toggle_2, WrapItems=boolean_toggle_2)  # -> ItemA, ItemB
relative_item_8 = RelativeItem(Tree=line_2, Offset="{+2}[0]", WrapPaths=boolean_toggle_2, WrapItems=boolean_toggle_2)  # -> ItemA, ItemB
boolean_toggle_3 = BooleanToggle(False)
line_5 = Line(relative_item_8.ItemB)
line_6 = Line(relative_item_8.ItemA)
line_7 = Line(relative_item_5.ItemA)
line_8 = Line(relative_item_5.ItemB)
line_9 = Line(relative_item_6.ItemA)
line_10 = Line(relative_item_6.ItemB)
line_11 = Line(relative_item_7.ItemA)
line_12 = Line(relative_item_7.ItemB)
relative_item_9 = RelativeItem(Tree=line_11, Offset="{+1}[0]", WrapPaths=boolean_toggle_3, WrapItems=boolean_toggle_3)  # -> ItemA, ItemB
relative_item_10 = RelativeItem(Tree=line_12, Offset="{+1}[0]", WrapPaths=boolean_toggle_3, WrapItems=boolean_toggle_3)  # -> ItemA, ItemB
relative_item_11 = RelativeItem(Tree=line_6, Offset="{+1}[0]", WrapPaths=boolean_toggle_3, WrapItems=boolean_toggle_3)  # -> ItemA, ItemB
relative_item_12 = RelativeItem(Tree=line_5, Offset="{+1}[0]", WrapPaths=boolean_toggle_3, WrapItems=boolean_toggle_3)  # -> ItemA, ItemB
relative_item_13 = RelativeItem(Tree=line_8, Offset="{+1}[0]", WrapPaths=boolean_toggle_3, WrapItems=boolean_toggle_3)  # -> ItemA, ItemB
relative_item_14 = RelativeItem(Tree=line_7, Offset="{+1}[0]", WrapPaths=boolean_toggle_3, WrapItems=boolean_toggle_3)  # -> ItemA, ItemB
relative_item_15 = RelativeItem(Tree=line_10, Offset="{+1}[0]", WrapPaths=boolean_toggle_3, WrapItems=boolean_toggle_3)  # -> ItemA, ItemB
relative_item_16 = RelativeItem(Tree=line_9, Offset="{+1}[0]", WrapPaths=boolean_toggle_3, WrapItems=boolean_toggle_3)  # -> ItemA, ItemB
line_13 = Line(relative_item_13.ItemB)
line_14 = Line(relative_item_14.ItemA)
line_15 = Line(relative_item_15.ItemB)
line_16 = Line(relative_item_16.ItemA)
line_17 = Line(relative_item_9.ItemB)
line_18 = Line(relative_item_10.ItemA)
line_19 = Line(relative_item_11.ItemB)
line_20 = Line(relative_item_12.ItemA)
cull_pattern = CullPattern(List=line_20, CullPattern=invert([False, True]))
cull_pattern_2 = CullPattern(List=line_17, CullPattern=[False, True])
cull_pattern_3 = CullPattern(List=line_18, CullPattern=invert([False, True]))
cull_pattern_4 = CullPattern(List=line_19, CullPattern=invert([False, True]))
cull_pattern_5 = CullPattern(List=line_20, CullPattern=[False, True])
flip_matrix_2 = FlipMatrix(Data=line_13)
flip_matrix_3 = FlipMatrix(Data=line_14)
flip_matrix_4 = FlipMatrix(Data=line_15)
flip_matrix_5 = FlipMatrix(Data=line_16)
flip_matrix_6 = FlipMatrix(Data=cull_pattern_2)
flip_matrix_7 = FlipMatrix(Data=cull_pattern_3)
flip_matrix_8 = FlipMatrix(Data=cull_pattern_4)
flip_matrix_9 = FlipMatrix(Data=cull_pattern_5)
flip_matrix_10 = FlipMatrix(Data=cull_pattern)

# ----
relative_item_17 = RelativeItem(Tree=line_12, Offset="{+1}[0]", WrapPaths=boolean_toggle_3, WrapItems=boolean_toggle_3)  # -> ItemA, ItemB
line_21 = Line(relative_item_17.ItemA)
cull_pattern_6 = CullPattern(List=line_21, CullPattern=[False, True])
flip_matrix_11 = FlipMatrix(Data=cull_pattern_6)
leftcenterlines = CSharpScript(lines=line_3)  # -> linesOut; inputs lines: tree of Line
# ---------- leftcenterlines: C# ----------
    var lineTree = new DataTree<Line>();

    for( int i = 0; i < lines.BranchCount; ++i )
      for( int j = 5; j < lines.Branch(i).Count; ++j )
      {

        if( i % 2 != 0 )
          lineTree.Add(lines.Branch(i)[j], new GH_Path(i));

      }

    linesOut = lineTree;
# ---------- end leftcenterlines ----------

# ---- group: GetAllTheValleysAndMountains
topbottomsecondlines = CSharpScript(lines=line_3)  # -> linesOut; inputs lines: tree of Line
# ---------- topbottomsecondlines: C# ----------
    var lineTree = new DataTree<Line>();

    for( int i = 1; i < lines.BranchCount - 1; ++i )
      for( int j = 3; j < lines.Branch(i).Count - 1; ++j )
      {

        if( i % 2 != 1 )
          lineTree.Add(lines.Branch(i)[j], new GH_Path(i));

      }

    linesOut = lineTree;
# ---------- end topbottomsecondlines ----------
leftcenterlines_2 = CSharpScript(lines=line_3)  # -> linesOut; inputs lines: tree of Line
# ---------- leftcenterlines_2: C# ----------
    var lineTree = new DataTree<Line>();

    for( int i = 0; i < lines.BranchCount - 1; ++i )
      for( int j = 5; j < lines.Branch(i).Count; ++j )
      {

        if( i % 2 != 0 )
          lineTree.Add(lines.Branch(i)[j], new GH_Path(i));

      }

    linesOut = lineTree;
# ---------- end leftcenterlines_2 ----------
rigthintersectionrlines = CSharpScript(lines=line_3)  # -> linesOut; inputs lines: tree of Line
# ---------- rigthintersectionrlines: C# ----------
    var lineTree = new DataTree<Line>();

    for( int i = 1; i < lines.BranchCount - 1; ++i )
      for( int j = 0; j < lines.Branch(i).Count - 5; ++j )
      {

        if( i % 2 != 1 )
          lineTree.Add(lines.Branch(i)[j], new GH_Path(i));

      }

    linesOut = lineTree;
# ---------- end rigthintersectionrlines ----------
centerlines = CSharpScript(lines=line_3)  # -> linesOut; inputs lines: tree of Line
# ---------- centerlines: C# ----------
    var lineTree = new DataTree<Line>();

    for( int i = 0; i < lines.BranchCount - 1; ++i )
      for( int j = 1; j < lines.Branch(i).Count - 3; ++j )
      {

        if( i % 2 != 0 )
          lineTree.Add(lines.Branch(i)[j], new GH_Path(i));

      }

    linesOut = lineTree;
# ---------- end centerlines ----------
panel_2 = Panel(topbottomsecondlines)
join_curves = JoinCurves(Curves=topbottomsecondlines, Preserve=False)  # -> simplify(Curves)
join_curves_2 = JoinCurves(Curves=rigthintersectionrlines, Preserve=False)  # -> simplify(Curves)
join_curves_3 = JoinCurves(Curves=leftcenterlines_2, Preserve=False)  # -> simplify(Curves)
join_curves_4 = JoinCurves(Curves=centerlines, Preserve=False)  # -> simplify(Curves)
numberofbranches = CSharpScript(lines=relative_item_13.ItemB)  # -> numberOfBranches; inputs lines: tree of Line
# ---------- numberofbranches: C# ----------
    numberOfBranches = lines.BranchCount - 1;
# ---------- end numberofbranches ----------
numberofbranches_2 = CSharpScript(lines=relative_item_15.ItemB)  # -> numberOfBranches; inputs lines: tree of Line; same code as numberofbranches
numberofbranches_3 = CSharpScript(lines=relative_item_17.ItemA)  # -> numberOfBranches; inputs lines: tree of Line; same code as numberofbranches
numberofbranches_4 = CSharpScript(lines=relative_item_12.ItemA)  # -> numberOfBranches; inputs lines: tree of Line; same code as numberofbranches
end_points = EndPoints(Curve=join_curves)  # -> Start, End
end_points_2 = EndPoints(Curve=join_curves_2)  # -> Start, End
end_points_3 = EndPoints(Curve=join_curves_3)  # -> Start, End
end_points_4 = EndPoints(Curve=join_curves_4)  # -> Start, End
line_22 = Line(StartPoint=end_points_4.Start, EndPoint=end_points_4.End)
line_23 = Line(StartPoint=end_points.Start, EndPoint=end_points.End)
line_24 = Line(StartPoint=end_points_3.Start, EndPoint=end_points_3.End)
line_25 = Line(StartPoint=end_points_2.Start, EndPoint=end_points_2.End)
topbottomlines = CSharpScript(lines=line_3)  # -> linesOut; inputs lines: tree of Line
# ---------- topbottomlines: C# ----------
    var lineTree = new DataTree<Line>();

    for( int i = 1; i < lines.BranchCount - 1; ++i )
      for( int j = 2; j < lines.Branch(i).Count - 4; ++j )
      {

        if( i % 2 != 1 )
          lineTree.Add(lines.Branch(i)[j], new GH_Path(i));

      }

    linesOut = lineTree;
# ---------- end topbottomlines ----------
rightcenterlines = CSharpScript(lines=line_3)  # -> linesOut; inputs lines: tree of Line
# ---------- rightcenterlines: C# ----------
    var lineTree = new DataTree<Line>();

    for( int i = 0; i < lines.BranchCount; ++i )
      for( int j = 4; j < lines.Branch(i).Count - 2; ++j )
      {

        if( i % 2 != 0 )
          lineTree.Add(lines.Branch(i)[j], new GH_Path(i));

      }

    linesOut = lineTree;
# ---------- end rightcenterlines ----------
leftintersectionrlines = CSharpScript(lines=line_3)  # -> linesOut; inputs lines: tree of Line
# ---------- leftintersectionrlines: C# ----------
    var lineTree = new DataTree<Line>();

    for( int i = 1; i < lines.BranchCount - 1; ++i )
      for( int j = 6; j < lines.Branch(i).Count; ++j )
      {

        if( i % 2 != 1 )
          lineTree.Add(lines.Branch(i)[j], new GH_Path(i));

      }

    linesOut = lineTree;
# ---------- end leftintersectionrlines ----------
leftleftintersectionrlines = CSharpScript(lines=line_3)  # -> linesOut; inputs lines: tree of Line
# ---------- leftleftintersectionrlines: C# ----------
    var lineTree = new DataTree<Line>();

    for( int i = 0; i < lines.BranchCount; ++i )
      for( int j = 0; j < lines.Branch(i).Count - 6; ++j )
      {

        if( i % 2 != 0 )
          lineTree.Add(lines.Branch(i)[j], new GH_Path(i));

      }

    linesOut = lineTree;
# ---------- end leftleftintersectionrlines ----------
list_item_6 = ListItem(List=flip_matrix_2, Index=numberofbranches, Wrap=True)
list_item_7 = ListItem(List=flip_matrix_3, Index=Slider(0, range=0..10), Wrap=True)
list_item_8 = ListItem(List=flip_matrix_4, Index=numberofbranches_2, Wrap=True)
list_item_9 = ListItem(List=flip_matrix_5, Index=Slider(0, range=0..10), Wrap=True)
list_item_10 = ListItem(List=flip_matrix_11, Index=numberofbranches_3, Wrap=True)
list_item_11 = ListItem(List=flip_matrix_10, Index=numberofbranches_4, Wrap=True)
list_item_12 = ListItem(List=flip_matrix_7, Index=1, Wrap=True)
list_item_13 = ListItem(List=flip_matrix_9, Index=1, Wrap=True)
list_item_14 = ListItem(List=flip_matrix_6, Index=0, Wrap=True)
list_item_15 = ListItem(List=flip_matrix_8, Index=0, Wrap=True)

# ----
join_curves_5 = JoinCurves(Curves=leftcenterlines, Preserve=False)  # -> simplify(Curves)
end_points_5 = EndPoints(Curve=join_curves_5)  # -> Start, End
line_26 = Line(StartPoint=end_points_5.Start, EndPoint=end_points_5.End)

# ---- group: HackyWayOfMakingTheMesh
topbottomsecondlines_2 = CSharpScript(lines=line_3)  # -> linesOut; inputs lines: tree of Line
# ---------- topbottomsecondlines_2: C# ----------
    var lineTree = new DataTree<Line>();

    for( int i = 0; i < lines.BranchCount; ++i )
      for( int j = 3; j < lines.Branch(i).Count - 1; ++j )
      {

        if( i % 2 != 1 )
          lineTree.Add(lines.Branch(i)[j], new GH_Path(i));

      }

    linesOut = lineTree;
# ---------- end topbottomsecondlines_2 ----------
rigthintersectionrlines_2 = CSharpScript(lines=line_3)  # -> linesOut; inputs lines: tree of Line
# ---------- rigthintersectionrlines_2: C# ----------
    var lineTree = new DataTree<Line>();

    for( int i = 0; i < lines.BranchCount; ++i )
      for( int j = 0; j < lines.Branch(i).Count - 5; ++j )
      {

        if( i % 2 != 1 )
          lineTree.Add(lines.Branch(i)[j], new GH_Path(i));

      }

    linesOut = lineTree;
# ---------- end rigthintersectionrlines_2 ----------
centerlines_2 = CSharpScript(lines=line_3)  # -> linesOut; inputs lines: tree of Line
# ---------- centerlines_2: C# ----------
    var lineTree = new DataTree<Line>();

    for( int i = 0; i < lines.BranchCount; ++i )
      for( int j = 1; j < lines.Branch(i).Count - 3; ++j )
      {

        if( i % 2 != 0 )
          lineTree.Add(lines.Branch(i)[j], new GH_Path(i));

      }

    linesOut = lineTree;
# ---------- end centerlines_2 ----------
join_curves_6 = JoinCurves(Curves=topbottomsecondlines_2, Preserve=False)  # -> simplify(Curves)
join_curves_7 = JoinCurves(Curves=rigthintersectionrlines_2, Preserve=False)  # -> simplify(Curves)
join_curves_8 = JoinCurves(Curves=centerlines_2, Preserve=False)  # -> simplify(Curves)
end_points_6 = EndPoints(Curve=join_curves_6)  # -> Start, End
end_points_7 = EndPoints(Curve=join_curves_7)  # -> Start, End
end_points_8 = EndPoints(Curve=join_curves_8)  # -> Start, End
line_27 = Line(StartPoint=end_points_7.Start, EndPoint=end_points_7.End)
line_28 = Line(StartPoint=end_points_6.Start, EndPoint=end_points_6.End)
topbottomlines_2 = CSharpScript(lines=line_3)  # -> linesOut; inputs lines: tree of Line
# ---------- topbottomlines_2: C# ----------
    var lineTree = new DataTree<Line>();

    for( int i = 0; i < lines.BranchCount; ++i )
      for( int j = 2; j < lines.Branch(i).Count - 4; ++j )
      {

        if( i % 2 != 1 )
          lineTree.Add(lines.Branch(i)[j], new GH_Path(i));

      }

    linesOut = lineTree;
# ---------- end topbottomlines_2 ----------
leftintersectionrlines_2 = CSharpScript(lines=line_3)  # -> linesOut; inputs lines: tree of Line
# ---------- leftintersectionrlines_2: C# ----------
    var lineTree = new DataTree<Line>();

    for( int i = 0; i < lines.BranchCount; ++i )
      for( int j = 6; j < lines.Branch(i).Count; ++j )
      {

        if( i % 2 != 1 )
          lineTree.Add(lines.Branch(i)[j], new GH_Path(i));

      }

    linesOut = lineTree;
# ---------- end leftintersectionrlines_2 ----------
line_29 = Line(StartPoint=end_points_8.Start, EndPoint=end_points_8.End)
curve_2 = Curve([list_item_10, list_item_11, list_item_12, list_item_13, list_item_14, list_item_15, rightcenterlines, leftleftintersectionrlines, list_item_8, list_item_9, topbottomlines_2, leftintersectionrlines_2])
curve_3 = Curve([line_27, line_28, line_26, line_29])
weaverbird_s_mesh_from_lines_weave_back = WeaverbirdsMeshFromLinesWeaveBack(Lines=flatten([curve_3, curve_2]), MaximumValence=Slider(4, range=0..10))

# ---- group: SetupForKangaroo / SimulationReset
reset = Button()
toggle = BooleanToggle(True)

# ---- group: SetupForKangaroo / mesh of flat folding pattern
mesh = Mesh(weaverbird_s_mesh_from_lines_weave_back)

# ---- group: Kangaroo2 / maintain edge lengths
medges = MeshEdges(Mesh=mesh)  # -> NakedEdges, InteriorEdges, NonManifoldEdges
length_line = LengthLine(Line=[medges.NakedEdges, medges.InteriorEdges], Strength=1)

# ---- group: Kangaroo2 / a weak plastic anchor on all points prevents drift
demesh = DeconstructMesh(Mesh=mesh)  # -> Vertices, Faces, Colours, Normals
plasticanchor = PlasticAnchor(Point=demesh.Vertices, Limit=0.01, Strength=0.1)

# ---- group: AnchorPointsAlthoughWeDontNeedThemNoMore
join_curves_9 = JoinCurves(Curves=line_3, Preserve=False)
join_curves_10 = JoinCurves(Curves=line_3, Preserve=False)
end_points_9 = EndPoints(Curve=join_curves_9)  # -> Start, End
end_points_10 = EndPoints(Curve=join_curves_10)  # -> Start, End
point = Point(end_points_9.End)
point_2 = Point(end_points_10.Start)
cull_pattern_7 = CullPattern(List=flatten(point), CullPattern=[True, False])
cull_pattern_8 = CullPattern(List=flatten(point_2), CullPattern=[True, False])

# ---- group: WeShouldntNeedThisOnes
load = Load(ForceVector=Vector(0, 0, 1))
point_3 = Point([cull_pattern_7, cull_pattern_8])
anchor = Anchor(Point=flatten(point_3), Strength=Slider(205, range=0..1000))

# ---- group: AttractorFitness
mesh_2 = Mesh(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)  # disabled

# ----
number_slider_5 = Slider(1, range=0..10)  # disabled
negative = Negative(Value=number_slider_5)  # disabled
unit_z = UnitZ(Factor=negative)  # disabled
loads_karamba = LoadsKaramba(Vector=unit_z, LCase=0, mode="Gravity")  # disabled

# ---- group: SetupForKangaroo
curve_4 = Curve([list_item_10, list_item_11, list_item_12, list_item_13, list_item_14, list_item_15, topbottomlines, rightcenterlines, leftintersectionrlines, leftleftintersectionrlines, list_item_6, list_item_7, list_item_8, list_item_9])
curve_5 = Curve([line_22, line_23, line_24, line_25])
curve_6 = Curve(curve_5)
valleys = Curve(flatten(curve_6))
folding = Slider(0.431, range=0..0.99)
angle = Panel("pi")
angle_2 = Panel("-pi")
rad = Radians(Degrees=Slider(-180, range=-360..360))
rad_2 = Radians(Degrees=Slider(45, range=-360..360))

# ---- group: SetupForKangaroo / WatchOut!ThisComponentHelpsToVisualizeIfTheNumberOnTheFirstParametersOnTheLeftIsOKOrNot
curve_7 = Curve(curve_4)

# ---- group: SetupForKangaroo (continued)
mountains = Curve(flatten(curve_7))

# ---- group: SetupForKangaroo / Mountain fold lines
crv = Curve(mountains)

# ---- group: SetupForKangaroo / Valley fold lines
crv_2 = Curve(valleys)

# ---- group: Kangaroo2
hingepoints = HingePoints(Mesh=mesh)  # -> _1, _2, _3, _4
multiplication = Multiplication(A=angle_2, B=folding)
multiplication_2 = Multiplication(A=angle, B=folding)
ln = Line(StartPoint=hingepoints._1, EndPoint=hingepoints._2)
show = Show(G=mesh)
hinge = Hinge(
    FoldStart=hingepoints._1,
    FoldEnd=hingepoints._2,
    Tip1=hingepoints._3,
    Tip2=hingepoints._4,
    RestAngle=multiplication_2,
    Strength=0.1)
hinge_2 = Hinge(
    FoldStart=hingepoints._1,
    FoldEnd=hingepoints._2,
    Tip1=hingepoints._3,
    Tip2=hingepoints._4,
    RestAngle=multiplication,
    Strength=0.1)
eval = EvaluateCurve(Curve=reparameterize(crv_2), Parameter=0.5)  # -> Point, Tangent, Angle
eval_2 = EvaluateCurve(Curve=reparameterize(crv), Parameter=0.5)  # -> Point, Tangent, Angle
eval_3 = EvaluateCurve(Curve=ln, Parameter=0.5)  # -> graft(Point), Tangent, Angle
dist = Distance(PointA=eval.Point, PointB=eval_3.Point)
dist_2 = Distance(PointA=eval_2.Point, PointB=eval_3.Point)
sort = SortList(Keys=dist)  # -> Keys, ValuesA
sort_2 = SortList(Keys=dist_2)  # -> Keys, ValuesA
item = ListItem(List=sort.Keys, Index=0, Wrap=True)
item_2 = ListItem(List=sort_2.Keys, Index=0, Wrap=True)
smaller = SmallerThan(FirstNumber=item, SecondNumber=0.01)  # -> flatten(SmallerThan), OrEqualTo
smaller_2 = SmallerThan(FirstNumber=item_2, SecondNumber=0.01)  # -> flatten(SmallerThan), OrEqualTo
cull = CullPattern(List=hinge_2, CullPattern=smaller.SmallerThan)
cull_2 = CullPattern(List=hinge, CullPattern=smaller_2.SmallerThan)

# ---- group: Kangaroo1
origami = Origami(mesh=flatten(mesh), valleys=crv_2, C=crv, num_2=angle_2, num=expr("-x", folding), num_3=angle)  # -> flatten(data_2), flatten(R); disabled
timer = Timer(TimerInterval=20, Target=kangaroo)  # disabled
kangaroo = KangarooPhysics(ForceObjects=flatten(origami.data_2), Settings=null, Geometry=origami.R, SimulationReset=toggle)  # -> Out, Iterations, ParticlesOut, GeometryOut, KE; disabled
mesh_3 = Mesh(kangaroo.GeometryOut)  # disabled

# ----
data = Data([length_line, cull, cull_2, show, plasticanchor, anchor])

# ---- group: Output
solver = Solver(GoalObjects=data, Reset=reset, Threshold=1e-15, Tolerance=0.01, On=toggle)  # -> I, V, O
onlymeshes = CSharpScript(x=solver.O)  # -> A; inputs x: tree
# ---------- onlymeshes: C# ----------
    var meshOut = new List<object>();

    for( int i = 0; i < x.BranchCount; ++i )
      for( int j = 0; j < x.Branch(i).Count; ++j )
      {
  
        if( x.Branch(i)[j] != null )
          
          if( x.Branch(i)[j].GetType() == typeof( Rhino.Geometry.Mesh ) )
        
            meshOut.Add(x.Branch(i)[j]);
  
      }

    A = meshOut;
# ---------- end onlymeshes ----------

# ----
zombiesolver = ZombieSolver(GoalObjects=data, Threshold=1e-10, Tolerance=0.01, MaxIterations=50000)  # -> I, V, O; disabled
onlymeshes_2 = CSharpScript(x=zombiesolver.O)  # -> A; inputs x: tree; disabled; same code as onlymeshes
closest_point = ClosestPoint(Point=point_3, Cloud=zombiesolver.V)  # -> ClosestPoint, CPIndex, Distance; disabled
mesh_to_shell_karamba = MeshToShellKaramba(Mesh=onlymeshes_2, LimitDistance_m=0.005)  # -> Element, Points, Info; disabled
remove_duplicate_points_karamba = RemoveDuplicatePointsKaramba(Point=closest_point.ClosestPoint, LimitDistance=0.005)  # -> OutPoint, Info, Indexes; disabled
support_karamba = SupportKaramba(PosInd=remove_duplicate_points_karamba.OutPoint, menu=[buttons(on, on, on, on, on, on)])  # disabled
assemble_model_karamba = AssembleModelKaramba(
    Points=mesh_to_shell_karamba.Points,
    Elem=mesh_to_shell_karamba.Element,
    Support=support_karamba,
    Load=loads_karamba,
    LimitDistance_m=0.005)  # -> Model, Info, Mass_kg, CenterOfGravity; disabled
analyzethi_karamba = AnalyzeThIKaramba(Model=assemble_model_karamba.Model)  # -> CalculatedModel, MaximumDisplacement_m, ResultingForceOfGravity_kN, ElasticEnergy_kNm; disabled
model_view_karamba = ModelViewKaramba(Model=analyzethi_karamba.CalculatedModel, LoadCaseFactorsForLinearSuperposition=1, IndexOfVisibleLoadcase=-1)  # -> Model, DeformedMesh, DeformedAxes, DeformedModel; disabled
shell_view_karamba = ShellViewKaramba(Model=model_view_karamba.Model, IndexOfLayer=0)  # -> Model, MeshesOfRenderedShells, LegendColors, LegendTags; disabled
mesh_4 = Mesh(shell_view_karamba.MeshesOfRenderedShells)  # disabled

# ==== cluster Origami: Fold a flat pattern into 3d origami
mesh = ClusterInput()
valleys = ClusterInput()

# ---- group: Mountains
C = ClusterInput()

# ---- group: Folding
num = ClusterInput()

# ---- group: -pi/2
num_2 = ClusterInput()

# ---- group: pi
num_3 = ClusterInput()

# ----
mesh_2 = Mesh(mesh)

# ---- group: GridPointNumbers
demesh = DeconstructMesh(Mesh=mesh_2)  # -> Vertices, Faces, Colours, Normals
points = PointList(Points=demesh.Vertices, Size=Slider(1, range=0..1))

# ----
hingepoints = HingePoints(Mesh=mesh_2)  # -> _1, _2, _3, _4
num_4 = Number(num)
num_5 = Number(num_2)
num_6 = Number(num_3)
ln = Line(StartPoint=hingepoints._1, EndPoint=hingepoints._2)
eval = EvaluateCurve(Curve=reparameterize(C), Parameter=0.5)  # -> Point, Tangent, Angle
eval_2 = EvaluateCurve(Curve=reparameterize(valleys), Parameter=0.5)  # -> Point, Tangent, Angle
multiplication = Multiplication(A=num_6, B=num_4)
unweld = UnweldMesh(Mesh=mesh_2, Angle=0)
eval_3 = EvaluateCurve(Curve=reparameterize(ln), Parameter=0.5)  # -> graft(Point), Tangent, Angle
multiplication_2 = Multiplication(A=num_5, B=num_4)
cp = ClosestPoint(Point=eval_3.Point, Cloud=eval.Point)  # -> ClosestPoint, CPIndex, Distance
cp_2 = ClosestPoint(Point=eval_3.Point, Cloud=eval_2.Point)  # -> ClosestPoint, CPIndex, Distance
strength = Panel("1")
strength_2 = Panel("1")

# ---- group: Forces
springsfrommesh = SpringsFromMesh(M=mesh_2, stiffness=100, B=1)
planarizequads = PlanarizeQuads(M=mesh_2, planarizestrength=1000)

# ----
larger = LargerThan(FirstNumber=0.01, SecondNumber=cp.Distance)  # -> LargerThan, OrEqualTo
num_7 = Number(strength_2)
larger_2 = LargerThan(FirstNumber=0.01, SecondNumber=cp_2.Distance)  # -> LargerThan, OrEqualTo
num_8 = Number(strength)
points_2 = PointList(Points=hingepoints._4, Size=Slider(1, range=0..1))
cull = CullPattern(List=num_7, CullPattern=larger.LargerThan)
cull_2 = CullPattern(List=num_8, CullPattern=larger_2.LargerThan)
cull_3 = CullPattern(List=multiplication_2, CullPattern=larger_2.LargerThan)
cull_4 = CullPattern(List=multiplication, CullPattern=larger.LargerThan)
addition = Addition(A=cull_2, B=cull)
addition_2 = Addition(A=cull_3, B=cull_4)
addition_3 = Addition(A=0, B=addition)  # -> flatten(Result)
addition_4 = Addition(A=0, B=addition_2)  # -> flatten(Result)
hinge = Hinge(
    Point1=hingepoints._1,
    Point2=hingepoints._2,
    Point3=hingepoints._3,
    Point4=hingepoints._4,
    Strength=addition_3,
    RestAngle=addition_4)
panel = Panel(addition_3)
panel_2 = Panel(addition_4)
data = Data([springsfrommesh, hinge, planarizequads])
data_2 = ClusterOutput(data)
R = ClusterOutput(unweld)

# ==== cluster PlanarizeQuads: Applies a planarization force to any quads in a mesh
M = ClusterInput()
mcomp = Decompose(Mesh=M)  # -> Vertices, Faces, Colours, Normals
vertices = FaceVertices(Face=mcomp.Faces)  # -> CornerA, CornerB, CornerC, CornerD
planarizestrength = ClusterInput()
item = ListItem(List=mcomp.Vertices, Index=vertices.CornerA, Wrap=False)
item_2 = ListItem(List=mcomp.Vertices, Index=vertices.CornerB, Wrap=False)
item_3 = ListItem(List=mcomp.Vertices, Index=vertices.CornerC, Wrap=False)
item_4 = ListItem(List=mcomp.Vertices, Index=vertices.CornerD, Wrap=False)
planarize = Planarize(Point1=item, Point2=item_2, Point3=item_3, Point4=item_4, PlanarizeStrength=planarizestrength)
equals = Equality(FirstNumber=vertices.CornerC, SecondNumber=vertices.CornerD)  # -> Equality, Inequality
cull = CullPattern(List=planarize, CullPattern=equals.Inequality)
L = ClusterOutput(cull)

# ==== cluster SpringsFromMesh: Turns all edges of a mesh into springs
M = ClusterInput()
medges = MeshEdges(Mesh=M)  # -> NakedEdges, InteriorEdges, NonManifoldEdges
crv = Curve([medges.NakedEdges, medges.InteriorEdges])
B = ClusterInput()
len = Length(Curve=crv)
multiplication = Multiplication(A=len, B=B)
stiffness = ClusterInput()
springs = SpringsFromLine(Connection=crv, Stiffness=stiffness, Damping=10, RestLength=multiplication, UpperCutoff=0, LowerCutoff=0, Plasticity=0)
S = ClusterOutput(springs)
